# Grasshopper definition grasshopper.gh (Grasshopper 1.0.7)

panel = Panel("""blue
white
fuchsia
yellow
green
red""")
number_slider = Slider(15, range=0..100)
number_slider_2 = Slider(6, range=0..10)
number_slider_3 = Slider(6, range=0..10)
point = Point([<point referenced from the Rhino model> x4])
# Nodes
number_slider_4 = Slider(0.521, range=0..1)
# Set
boolean_toggle = BooleanToggle(True)
count = Slider(43, range=0..100)
panel_2 = Panel(point)
deconstruct = Deconstruct(Point=point)  # -> XComponent, YComponent, ZComponent
colour_swatch = ColourSwatch(SwatchColor=RGB(255, 255, 255))
colour_wheel = ColourWheel(
    ColourGrips_Style=31,
    ColourGrips_Grip=[0, 2.094395102, 4.188790205, 3.141592654],
    ColourGrips_Lum=[0.1, 0.5],
    ColourGrips_Range=[0.2617993878, 0.2617993878, 0.2617993878, 0.2617993878],
    ColourGrips_Sat=[0.2, 0.8408843247])
panel_3 = Panel("""123
123
24
5
126
23
2462""")
larger_than = LargerThan(FirstNumber=Slider(6, range=0..10), SecondNumber=Slider(2, range=0..10))  # -> LargerThan, OrEqualTo
# Maths / Logical Operations
equality = Equality(FirstNumber=Slider(6, range=0..10), SecondNumber=Slider(6, range=0..10))  # -> Equality, Inequality
division = Division(A=number_slider_2, B=number_slider)
division_2 = Division(A=Slider(5, range=0..10), B=Slider(5, range=0..10))
# Maths
addition = Addition(A=number_slider_2, B=number_slider)
insert_items = InsertItems(List=panel, Item="orange", Indices=Slider(6, range=0..10), Wrap=True)
list_length = ListLength(List=panel)
gate_or = GateOr(A=Toggle(False), B=boolean_toggle)
concatenate = Concatenate(FragmentA="hello", FragmentB="world", JoinSeparator="_")
panel_4 = Panel(panel)
# Params / Geometry
panel_5 = Panel(deconstruct.XComponent)
construct_domain = ConstructDomain(DomainStart=Slider(10, range=0..10), DomainEnd=Slider(74, range=0..100))
list_item = ListItem(List=panel, Index=number_slider_3, Wrap=True)
panel_6 = Panel(number_slider_4)
list_item_2 = ListItem(List=panel, Index=number_slider_3, Wrap=Toggle(False))
construct_domain_2 = ConstructDomain(DomainStart=Slider(121, range=0..1000), DomainEnd=Slider(166, range=0..1000))
multiplication = Multiplication(A=addition, B=division_2)
sort_list = SortList(Keys=panel_3)  # -> Keys, ValuesA
partition_list = PartitionList(List=insert_items, Size=Slider(4, range=0..10))
panel_7 = Panel(gate_or)
panel_8 = Panel(insert_items)
panel_9 = Panel(division)
panel_10 = Panel(addition)
panel_11 = Panel(equality.Equality)
panel_12 = Panel(larger_than.LargerThan)
panel_13 = Panel(list_length)
panel_14 = Panel(list_item_2)
panel_15 = Panel(list_item)
panel_16 = Panel(concatenate)
series = Series(Start=0, Step=Slider(8, range=0..10), Count=count)
random = Random(Range=construct_domain, Number=count, Seed=Slider(7, range=0..10))
random_2 = Random(Range=construct_domain, Number=count, Seed=Slider(8, range=0..10))
panel_17 = Panel(construct_domain_2)
random_3 = Random(Range=construct_domain, Number=count, Seed=Slider(3, range=0..10))
series_2 = Series(Start=0, Step=Slider(3, range=0..10), Count=count)
cull_nth = CullNth(List=panel_4, CullFrequency=Slider(3, range=0..10))
# Vector
series_3 = Series(Start=0, Step=Slider(8, range=0..10), Count=count)
cull_index = CullIndex(List=panel_4, Indices=[Slider(3, range=0..10), Slider(8, range=0..10), Slider(4, range=0..10)], Wrap=True)
panel_18 = Panel(multiplication)
panel_19 = Panel(partition_list)
panel_20 = Panel(sort_list.Keys)
reverse_list = ReverseList(List=panel_8)
larger_than_2 = LargerThan(FirstNumber=panel_20, SecondNumber=Slider(0, range=0..1000))  # -> LargerThan, OrEqualTo
gate_and = GateAnd(A=panel_11, B=panel_12, C=Toggle(True))
text_length = TextLength(Text=panel_16)
text_split = TextSplit(Text=panel_16, Separators="_")
panel_21 = Panel(cull_nth)
construct_point = ConstructPoint(XCoordinate=random_3, YCoordinate=random, ZCoordinate=random_2)
panel_22 = Panel(cull_index)
random_4 = Random(Range=panel_17, Number=Slider(10, range=0..100), Seed=2)
construct_point_2 = ConstructPoint(XCoordinate=series_3, YCoordinate=series_2, ZCoordinate=series)
panel_23 = Panel(reverse_list)
replace_text = ReplaceText(Text=panel_16, Find="World", Replace="me", RecursiveReplace=False)
panel_24 = Panel(gate_and)
panel_25 = Panel(text_length)
panel_26 = Panel(text_split)
panel_27 = Panel(random_4)
dispatch = Dispatch(List=panel_20, DispatchPattern=larger_than_2.LargerThan)  # -> ListA, ListB
panel_28 = Panel(replace_text)
duplicate_data = DuplicateData(Data=panel_21, Number=Slider(3, range=0..10), Order=True)
point_2 = Point(construct_point)
split_list = SplitList(List=panel_20, Index=Slider(4, range=0..10))  # -> ListA, ListB
panel_29 = Panel(duplicate_data)
panel_30 = Panel(dispatch.ListA)
panel_31 = Panel(split_list.ListA)
panel_32 = Panel(split_list.ListB)
sort_text = SortText(Keys=panel_29, Culture=127)  # -> Keys, Values
panel_33 = Panel(sort_text.Keys)
