# Grasshopper definition l_10.gh (Grasshopper 1.0.7)

# ---- group: using of API
crv = Curve([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])
python = GhPythonScript(extrude_path=crv)  # -> out, a, b, c; inputs extrude_path: list
# ---------- python: Python ----------
__author__ = "Mann"
__version__ = "2020.01.09"

import rhinoscriptsyntax as rs
import ghpythonlib.components as ghcomp


p1 = rs.CreatePoint(0.5,0.7,0.8)
p2 = rs.CreatePoint(100,100.7,100.8)
p3 = rs.CreatePoint(300,100.7,100.8)

a = rs.AddPolyline([p1,p2,p3])

plane = rs.WorldXYPlane()
plane = rs.RotatePlane(plane, 45.0, [0,0,1])
rectangle = rs.AddRectangle( plane, 5.0, 15.0 )

b = []
b.append(rs.ExtrudeCurve(rectangle,extrude_path[0]))
b.append(rs.ExtrudeCurve(rectangle,extrude_path[1]))

# creating closed brep with GH API

plane = rs.WorldXYPlane()
rectangle = rs.AddRectangle( plane, 50.0, 150.0 )
path = rs.AddLine([0,10,0], [0,0,-100])
box = rs.ExtrudeCurve( rectangle, path )
rs.CapPlanarHoles(box)
c = box
# ---------- end python ----------

# ---- group: using of GH nodes in Python
python_2 = GhPythonScript()  # -> out, points
# ---------- python_2: Python ----------
__author__ = "Mann"
__version__ = "2020.01.09"

import rhinoscriptsyntax as rs
import ghpythonlib.components as ghcomp

# creating points via populated3D node from GH
# note that we are creating also with GH node
# other way is to use referenced data

box = ghcomp.CenterBox(rs.WorldXYPlane(),100,100,100)
points = ghcomp.Populate3D(box,100,1)
# ---------- end python_2 ----------
