# Grasshopper definition l_7_python example.gh (Grasshopper 1.0.7)

buildings = Geometry([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])
contour = Contour(Shape=buildings, Point=Point(0, 0, 0), Direction=Vector(0, 0, 1), Distance=10)
trim = TrimTree(Tree=contour, Depth=1)
volume = Volume(Geometry=buildings)  # -> Volume, Centroid
item = ListItem(List=trim, Index=0, Wrap=True)
area = Area(Geometry=item)  # -> flatten(Area), Centroid
len = Length(Curve=item)  # -> flatten(Length)
python = GhPythonScript(
    volumes=volume.Volume,
    maximum_height=Slider(1, range=1..250),
    per_person=Slider(5, range=5..30),
    site_c_length=len,
    area=area.Area)  # -> out, a; inputs volumes: list, maximum_height: list, per_person: list, site_c_length: list, area: list
# ---------- python: Python ----------
__author__ = "Mann"
__version__ = "2019.12.05"

import rhinoscriptsyntax as rs


# functions
# for loop
# if statements

def Analyze_Volume(volume):
    if(volume>10000):
        print("too big")
    else:
        print("it's OK")
        

for item in volumes:
    #print(item)
    Analyze_Volume(item)
# ---------- end python ----------

old_city = BooleanToggle(True)
python_2 = GhPythonScript(
    toggle=old_city,
    test_subject=Slider(46, range=0..100),
    old_town=Slider(10, range=0..10),
    downtown=Slider(250, range=0..1000))  # -> out, a
# ---------- python_2: Python ----------
__author__ = "Mann"
__version__ = "2019.12.05"

import rhinoscriptsyntax as rs

result = 0
if(toggle == True):
    if(test_subject <= old_town):
        result = True
    else:
        result = False
else:
    if(test_subject <= downtown):
        result = True
    else:
        result = False
        
a = result
# ---------- end python_2 ----------
panel = Panel(python_2.a)
