# Grasshopper definition gen_mk2.gh (Grasshopper 1.0.7)

python = GhPythonScript(seed=Slider(4, range=0..10))  # -> out, a, surface, concrete
# ---------- python: Python ----------
__author__ = "Mann"
__version__ = "2020.01.11"

import rhinoscriptsyntax as rs
import scriptcontext as sc
import Rhino as rh
import ghpythonlib.components as ghcomp
import pickle



    
class Zone():
    version = ""
    def __init__ (self, site):
        self.site = site
    
    def Name(self):
        return self.version
        
    def Geo(self):
        print("no special geo here",self.version)
        res = {}
        res["surface"] = [self.site]
        return res

class Building(Zone):
    version = "building"
    height = None
    def __init__ (self,site,height):
        self.site  = site
        self.height = height
    def Geo(self):
        #print(self.site)
        res = {}
        res["surface"] = [self.site]
        line = rs.AddLine((0,0,0), (0,0,self.height))
        res["concrete"] = [rs.ExtrudeSurface(self.site,line)]
        
        return res
    
class Park(Zone):
    version = "park"

    def Geo(self):
        res = {}
        res["surface"] = [self.site]
        return res


def layer_objects(names):
    sc.doc = rh.RhinoDoc.ActiveDoc
    
    all_objs = []
    
    for layer in names:
        objs = rs.ObjectsByLayer(layer)
        if objs:
            objs = [rs.coercegeometry(x) for x in objs]
            all_objs.extend(objs)
            
    sc.doc = ghdoc
    return all_objs

class CT():
    sites = []
    zones = []
    
    def __init__(self):
        print("initializing")
        self.curves = layer_objects(["boundaries"])
        target_surface = layer_objects(["surface"])
        
        sites = ghcomp.SurfaceSplit(target_surface,self.curves)
        
        self.sites = []
        for site in sites:
            srf = rs.coercesurface(site)
            area = rs.SurfaceArea(srf)[0]
            if(area < 1500):
                self.sites.append(site)

        
    def Load(self):
        print("loading")
        
    def Save(self):
        print("saving")
        
    def Generate(self):
        print("generating")
        num = len(self.sites)
        print("total sites",num)
        
        distribution = ghcomp.Random([0,1],num,seed)
        distribution = distribution[num:num*2]
        distribution = [round(x) for x in distribution]
        
        heights = ghcomp.Random([2,50],num,seed)
        heights = heights[num:num*2]
        #heights = [round(x) for x in heights]
        
        
        self.zones = []
        for i in range(num):
            if(distribution[i]):
                self.zones.append(Park(self.sites[i]))
            else:
                self.zones.append(Building(self.sites[i],heights[i]))
                
    
    def GetGeo(self):
        res = {}
        for zone in self.zones:
            temp = zone.Geo()
            keys = temp.keys()
            
            for key in keys:
                #print("key",key)
                if(res.has_key(key)):
                    #print("appeding to",key)
                    res[key].extend(temp[key])
                else:
                    #print("creating key",key)
                    res[key] = []
                    res[key].extend(temp[key])
        return res

            

        
superstadt = CT()
superstadt.Load()
superstadt.Generate()
all_geo = superstadt.GetGeo()

surface = all_geo.get("surface")
concrete = all_geo.get("concrete")
# ---------- end python ----------
preview = CustomPreview(Geometry=python.surface, Material=ColourSwatch(SwatchColor=RGB(145, 145, 145)))
preview_2 = CustomPreview(Geometry=python.concrete, Material=ColourSwatch(SwatchColor=RGB(69, 69, 69)))
panel = Panel(python.surface)
