# Grasshopper definition gh2python_translation.gh (Grasshopper 1.0.7)

# ----
# Let's analyze how GH definition can be translated into Python
gallery = ImageGallery(CycleDelay=30, Randomize=False, UseLocalImages=True, UseRemoteImages=True)

heights = GenePool(Decimals=0, Maximum=60, Minimum=0, Value=[20, 27, 50, 36])
heights_2 = Number(graft(heights))
sites = Curve(Tree({0}: [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], {1}: [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], {2}: [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], {3}: [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]))

# ----
# Template Example
number_slider = Slider(2, range=0..10)
offset = OffsetCurve(Curve=sites, Distance=expr("-x", number_slider), Plane=PlaneXY(0, 0, 0), Corners=1)
Z = UnitZ(Factor=heights_2)
crv = Curve(sites)
extr = Extrude(Base=offset, Direction=Z)
cap = CapHoles(Brep=extr)
contour = Contour(Shape=extr, Point=Point(0, 0, 0), Direction=Vector(0, 0, 1), Distance=Slider(3.2, range=0..10))
preview = CustomPreview(
    Geometry=cap,
    Material={diffuse=RGB(99, 99, 99), emission=RGB(30, 30, 30), shine=0.5, specular=RGB(255, 255, 255), transparency=0.3960784314})
preview_2 = CustomPreview(
    Geometry=contour,
    Material={diffuse=RGB(43, 43, 43), emission=RGB(13, 13, 13), shine=0.5, specular=RGB(255, 255, 255), transparency=0})
preview_3 = CustomPreview(
    Geometry=crv,
    Material={diffuse=RGB(43, 43, 43), emission=RGB(13, 13, 13), shine=0.5, specular=RGB(255, 255, 255), transparency=0})

# ----
# Python Translation
python = GhPythonScript(sites=sites, heights=heights_2)  # -> out, volumes, levels, areas, type, a; inputs sites: Curve
# ---------- python: Python ----------
__author__ = "Mann"
__version__ = "2020.01.21"

import rhinoscriptsyntax as rs
import scriptcontext as sc
import Rhino as rh
import ghpythonlib.components as ghcomp
#--
from System import *
from Rhino import *
from Rhino.DocObjects import *
from Rhino.Geometry import *
from Rhino.Input import *
from Rhino.Input.Custom import *
from Rhino.Commands import *
from scriptcontext import doc

#selection
site = sites

#print(site)

height = heights

#computing desired site by offseting
correct_site = ghcomp.OffsetCurve(site,-2,rs.WorldXYPlane(),1)

#making extrusion
vector1 = (0,0,0)
vector2 = (0,0,height)
vector = rs.VectorAdd(vector1, vector2)
extrusion = ghcomp.Extrude(correct_site,vector)
volumes = ghcomp.CapHoles(extrusion)


#computing floor sections
level_height = 3.2
lvls = Brep.CreateContourCurves(volumes, Point3d(0,0,0), Point3d(0,0,height), level_height)
levels = lvls 

#computing area
srf = ghcomp.BoundarySurfaces(correct_site)
areas = round(ghcomp.Area(srf)[0])

#detecting class
if(0 < height <= 25):type = "Small"
if(24 < height <= 40):type = "Medium"
if(40 < height):type = "Highrise"
# ---------- end python ----------
data = Data(python.a)
data_2 = Data(python.levels)
preview_4 = CustomPreview(
    Geometry=python.volumes,
    Material={diffuse=RGB(99, 99, 99), emission=RGB(30, 30, 30), shine=0.5, specular=RGB(255, 255, 255), transparency=0.3960784314})
panel = Panel(python.areas)
panel_2 = Panel(python.type)

crv_2 = Curve(data_2)  # disabled
lng = ListLength(List=crv_2)
subtraction = Subtraction(A=lng, B=2)
dom = ConstructDomain(DomainStart=1, DomainEnd=subtraction)
subset = SubList(List=crv_2, Domain=dom, Wrap=True)  # -> List, Index

# ----
# Stage 2 - Translate logical blocks
crv_3 = Curve(data_2)  # disabled
python_2 = GhPythonScript(levels=crv_3)  # -> out, a; inputs levels: list
# ---------- python_2: Python ----------
__author__ = "Mann"
__version__ = "2020.01.22"

import rhinoscriptsyntax as rs

total_length = len(levels)
print(total_length)
a = levels[1:-1]
# ---------- end python_2 ----------

# ----
# Stage 3 - Merge all together in one GhPython
crv_4 = Curve(data_2)
python_3 = GhPythonScript(x=crv_4)  # -> out, a; inputs x: list
# ---------- python_3: Python ----------
__author__ = "Mann"
__version__ = "2020.01.22"

import rhinoscriptsyntax as rs

a = "You can merge code yourself :)"
# ---------- end python_3 ----------

# ----
# Stage 1 - Only Grasshopper
number_slider_2 = Slider(1, range=0..10)
subtraction_2 = Subtraction(A=number_slider_2, B=Slider(0.2, range=0..1))

number_slider_3 = Slider(1, range=0..10)
subtraction_3 = Subtraction(A=number_slider_3, B=Slider(0.2, range=0..1))

panel_3 = Panel(python_3.a)

offset_2 = OffsetCurve(Curve=subset.List, Distance=subtraction_2, Plane=PlaneXY(0, 0, 0), Corners=1)
explode = Explode(Curve=offset_2, Recursive=True)  # -> Segments, Vertices
Z_2 = UnitZ(Factor=Slider(1.4, range=0..10))
trim = TrimTree(Tree=explode.Segments, Depth=1)
move = Move(Geometry=explode.Segments, Motion=Z_2)  # -> Geometry, Transform
len = Length(Curve=move.Geometry)
division = Division(A=len, B=Slider(1, range=0..10))
round = Round(Number=division)  # -> Nearest, Floor, Ceiling
divide = DivideCurve(Curve=trim, Count=round.Nearest, Kinks=False)  # -> Points, Tangents, Parameters
divide_2 = DivideCurve(Curve=move.Geometry, Count=round.Nearest, Kinks=False)  # -> Points, Tangents, Parameters
cullpt = CullDuplicates(Points=divide.Points, Tolerance=0.1, CullMode=3)  # -> Points, Indices, Valence
cullpt_2 = CullDuplicates(Points=divide_2.Points, Tolerance=0.1, CullMode=3)  # -> Points, Indices, Valence
ln = Line(StartPoint=cullpt.Points, EndPoint=cullpt_2.Points)

# ---- group: global classification
data_3 = Data(heights_2)
smaller = SmallerThan(FirstNumber=data_3, SecondNumber=[Slider(10, range=0..100), Slider(25, range=0..100), Slider(40, range=0..100)])  # -> SmallerThan, OrEqualTo
panel_4 = Panel("""Highrise
Medium
Small""")
ma = MassAddition(Input=smaller.SmallerThan)  # -> Result, PartialResults
item = ListItem(List=panel_4, Index=ma.Result, Wrap=True)
building_class = Panel(item)

# ---- group: some calculations on internal data
per_person = Slider(25, range=0..100)
area = Area(Geometry=contour)  # -> Area, Centroid
division_2 = Division(A=area.Area, B=per_person)
trim_2 = TrimTree(Tree=division_2, Depth=1)
round_2 = Round(Number=trim_2)  # -> Nearest, Floor, Ceiling
ma_2 = MassAddition(Input=round_2.Nearest)  # -> Result, PartialResults
persons_per_building = Panel(ma_2.Result)

# ----
python_4 = GhPythonScript(levels=python_2.a, offset=subtraction_3)  # -> out, bottom_line, upper_line; inputs levels: Curve
# ---------- python_4: Python ----------
__author__ = "Mann"
__version__ = "2020.01.22"

import rhinoscriptsyntax as rs
import ghpythonlib.components as ghcomp

#create curves with offset
off = ghcomp.OffsetCurve(levels,offset,rs.WorldXYPlane(),1)

#exploding into fragments
#note, that we are accessing index 0 to take only curve

bottom_line = ghcomp.Explode(off,True)[0] 

#create upper line
height = 1.2
vector1 = (0,0,0)
vector2 = (0,0,height)
vector = rs.VectorAdd(vector1, vector2)
upper_line = ghcomp.Move(bottom_line, vector)[0]
# ---------- end python_4 ----------
python_5 = GhPythonScript(bottom_lines=python_4.bottom_line, upper_lines=python_4.upper_line)  # -> out, a; inputs bottom_lines: list of Curve, upper_lines: list of Curve
# ---------- python_5: Python ----------
__author__ = "Mann"
__version__ = "2020.01.22"

import rhinoscriptsyntax as rs
import ghpythonlib.components as ghcomp

#doing division
lengths = ghcomp.Length(upper_lines)

step = 1.0
num = []
for unit in lengths:
    num.append(round(unit/step))

columns = []

for i in range(len(bottom_lines)):
    points_bottom = ghcomp.DivideCurve(bottom_lines[i],num[i],False)[0]
    points_top = ghcomp.DivideCurve(upper_lines[i],num[i],False)[0]
    #print(points_top)
    lines = ghcomp.Line(points_top, points_bottom)
    print(lines)
    columns.extend(lines) #note that we're using here extend instead of append
    
a = columns
# ---------- end python_5 ----------

python_6 = GhPythonScript(levels=python_2.a, offset=number_slider_3)  # -> out, a; inputs levels: Curve
# ---------- python_6: Python ----------
__author__ = "Mann"
__version__ = "2020.01.22"

import rhinoscriptsyntax as rs
import ghpythonlib.components as ghcomp

#create curves with offset
off = ghcomp.OffsetCurve(levels,offset,rs.WorldXYPlane(),1)

#create rules surface
surfaces = ghcomp.RuledSurface(levels,off)

#extrude

height = -0.2
vector1 = (0,0,0)
vector2 = (0,0,height)
vector = rs.VectorAdd(vector1, vector2)
extrusion = ghcomp.Extrude(surfaces, vector)
a = extrusion
# ---------- end python_6 ----------
preview_5 = CustomPreview(Geometry=python_6.a, Material=ColourSwatch(SwatchColor=RGB(156, 156, 156)))

offset_3 = OffsetCurve(Curve=subset.List, Distance=number_slider_2, Plane=PlaneXY(0, 0, 0), Corners=1)
trim_3 = TrimTree(Tree=offset_3, Depth=1)
rulesrf = RuledSurface(CurveA=subset.List, CurveB=trim_3)
Z_3 = UnitZ(Factor=Slider(0.2, range=0..1))
extr_2 = Extrude(Base=rulesrf, Direction=Z_3)
preview_6 = CustomPreview(Geometry=extr_2, Material=ColourSwatch(SwatchColor=RGB(156, 156, 156)))

crv_5 = Curve([python_5.a, python_4.upper_line])
python_7 = GhPythonScript(x=crv_5)  # -> out, a; inputs x: Curve
# ---------- python_7: Python ----------
__author__ = "Mann"
__version__ = "2020.01.22"

import rhinoscriptsyntax as rs
import ghpythonlib.components as ghcomp

a = ghcomp.Pipe(x,0.1,1)
# ---------- end python_7 ----------
preview_7 = CustomPreview(Geometry=python_7.a, Material=ColourSwatch(SwatchColor=RGB(217, 217, 217)))

crv_6 = Curve([ln, move.Geometry])
pipe = Pipe(Curve=crv_6, Radius=Slider(0.1, range=0..1), Caps=1)  # disabled
preview_8 = CustomPreview(Geometry=pipe, Material=ColourSwatch(SwatchColor=RGB(217, 217, 217)))
