# Grasshopper definition mold.gh (Grasshopper 1.0.7)

number_slider = Slider(210, range=0..1000)
rectangle = Rectangle(Plane=PlaneXY(0, 0, 0), XSize=number_slider, YSize=number_slider, Radius=0)  # -> Rectangle, Length
offset_curve = OffsetCurve(Curve=rectangle.Rectangle, Distance=Slider(10, range=0..10), Plane=PlaneXY(0, 0, 0), Corners=1)
initial_rectangle = Curve(rectangle.Rectangle)
offset = Curve(offset_curve)
altogether = Curve(flatten([initial_rectangle, offset]))
unit_z = UnitZ(Factor=Slider(20, range=0..100))
curve = Curve(offset_curve)
loft = Loft(Curves=altogether, Options={Adjust=False, Closed=False, LoftEnds=0, LoftSimp=0, LoftType=0, Rebuild=10, Refit=0.01})
unit_z_2 = UnitZ(Factor=Slider(40, range=0..100))
reverse = Reverse(Vector=unit_z)
extrude = Extrude(Base=curve, Direction=reverse)
extrude_2 = Extrude(Base=loft, Direction=unit_z_2)
number_slider_2 = Slider(22, range=0..100)
starting_point = Point(<point referenced from the Rhino model>)
cap_holes = CapHoles(Brep=extrude)
rectangular = Rectangular(Plane=PlaneXY(0, 0, 0), SizeX=1, SizeY=2, ExtentX=10, ExtentY=5)  # -> Cells, Points
hexagonal = Hexagonal(Plane=starting_point, Size=Slider(7, range=0..10), ExtentX=number_slider_2, ExtentY=number_slider_2)  # -> flatten(Cells), flatten(Points)
triangular = Triangular(Plane=PlaneXY(0, 0, 0), Size=1, ExtentX=5, ExtentY=5)  # -> Cells, Points
grid_points = Point(hexagonal.Points)
cells = Curve(hexagonal.Cells)
point_in_curve = PointInCurve(GridPoints=grid_points, Rectangle=rectangle.Rectangle)  # -> Relationship, Point
equality = Equality(FirstNumber=point_in_curve.Relationship, SecondNumber=Slider(0, range=0..100))  # -> Equality, Inequality
attractor = Point(<point referenced from the Rhino model>)
dispatch_for_cells = Dispatch(List=cells, DispatchPattern=equality.Equality)  # -> ListA, ListB
dispatch_for_points = Dispatch(List=grid_points, DispatchPattern=equality.Equality)  # -> ListA, ListB
line = Line(StartPoint=attractor, EndPoint=grid_points)
cells_2 = Curve(dispatch_for_cells.ListB)
grid_points_2 = Point(dispatch_for_points.ListB)
distance = Distance(PointA=attractor, PointB=grid_points_2)
sort_list = SortList(Keys=distance)  # -> Keys, ValuesA
reverse_list = ReverseList(List=sort_list.Keys)
panel = Panel(reverse_list)
list_item = ListItem(List=reverse_list, Index=0, Wrap=True)
division = Division(A=distance, B=list_item)
graph_mapper = GraphMapper(division, x0=0, x1=1, y0=0, y1=1, Ox=0.5, Oy=0, Px=0.75, Py=0.25, container_name="Parabola")
multiplication = Multiplication(A=graph_mapper, B=Slider(35, range=0..100))
unit_z_3 = UnitZ(Factor=multiplication)
extrude_3 = Extrude(Base=cells_2, Direction=unit_z_3)
cap_holes_2 = CapHoles(Brep=extrude_3)
all_geometry = Brep([extrude_2, cap_holes, cap_holes_2])
custom_preview = CustomPreview(Geometry=all_geometry, Material=ColourSwatch(SwatchColor=RGB(66, 29, 29)))
