# Grasshopper definition l_3.gh (Grasshopper 1.0.7)
# plug-ins: LunchBox

construct_domain = ConstructDomain(DomainStart=Slider(1, range=0..1), DomainEnd=Slider(6, range=0..10))
range = Range(Domain=construct_domain, Steps=Slider(7, range=5..15))
panel = Panel(range)

curve = Curve(<curve referenced from the Rhino model>)

number_slider = Slider(12, range=5..115)
number_slider_2 = Slider(9, range=0..10)
range_2 = Range(Domain=Domain(0, 1), Steps=number_slider)
curve_2 = Curve(<curve referenced from the Rhino model>)
curve_3 = Curve(<curve referenced from the Rhino model>)
list_length = ListLength(List=range_2)
addition = Addition(A=number_slider, B=1)
series = Series(Start=0, Step=number_slider_2, Count=addition)
tween_curve = TweenCurve(CurveA=curve_3, CurveB=curve_2, Factor=range_2, BlendType=0)
unit_z = UnitZ(Factor=series)
reverse_list = ReverseList(List=unit_z)
move = Move(Geometry=tween_curve, Motion=reverse_list)  # -> Geometry, Transform
unit_z_2 = UnitZ(Factor=number_slider_2)
boundary_surfaces = BoundarySurfaces(Edges=move.Geometry)
extrude = Extrude(Base=boundary_surfaces, Direction=unit_z_2)
custom_preview = CustomPreview(Geometry=extrude, Material=ColourSwatch(SwatchColor=RGB(255, 255, 255)))

unit_z_3 = UnitZ(Factor=Slider(20, range=0..100))

curve_4 = Curve(<curve referenced from the Rhino model>)
divide_length = DivideLength(Curve=curve_4, Length=Slider(2, range=0..10))  # -> Points, Tangents, Parameters
unit_z_4 = UnitZ(Factor=Slider(1.2, range=0..10))
move_2 = Move(Geometry=divide_length.Points, Motion=unit_z_4)  # -> Geometry, Transform
move_3 = Move(Geometry=curve_4, Motion=unit_z_4)  # -> Geometry, Transform
line = Line(StartPoint=divide_length.Points, EndPoint=move_2.Geometry)
pipe = Pipe(Curve=[line, move_3.Geometry], Radius=Slider(0.04, range=0..0.5), Caps=0)

extrude_2 = Extrude(Base=curve, Direction=unit_z_3)
deconstruct_brep = DeconstructBrep(Brep=extrude_2)  # -> Faces, Edges, Vertices
diagrid_structure = DiagridStructure(Surface=deconstruct_brep.Faces, UDivisions=10, VDivisions=10, Type=True)  # -> StructureLines, StructureNodes

# ---- group: polygon gen
unit_z_5 = UnitZ(Factor=Slider(24, range=0..100))

# ----
point = Point(<point referenced from the Rhino model>)
circle_cnr = CircleCNR(Center=point, Normal=Vector(0, 0, 1), Radius=Slider(10, range=0..100))

# ---- group: polygon gen
polygon = Polygon(Plane=point, Radius=Slider(7, range=0..100), Segments=Slider(3, range=0..10), FilletRadius=0)  # -> Polygon, Length
unit_z_6 = UnitZ(Factor=Slider(56, range=0..100))
move_4 = Move(Geometry=polygon.Polygon, Motion=unit_z_6)  # -> Geometry, Transform

polygon_2 = Polygon(Plane=point, Radius=Slider(13, range=0..100), Segments=Slider(6, range=0..10), FilletRadius=0)  # -> Polygon, Length
move_5 = Move(Geometry=polygon_2.Polygon, Motion=unit_z_5)  # -> Geometry, Transform

# ----
curve_5 = Curve([circle_cnr, move_5.Geometry, move_4.Geometry])
loft = Loft(Curves=curve_5, Options={Adjust=False, Closed=False, LoftEnds=0, LoftSimp=0, LoftType=0, Rebuild=10, Refit=0.01})
contour = Contour(Shape=loft, Point=point, Direction=Vector(0, 0, 1), Distance=Slider(3, range=0..10))
boundary_surfaces_2 = BoundarySurfaces(Edges=contour)
