# Grasshopper definition l_4.gh (Grasshopper 1.0.7)

cylinder_points = Point([<point referenced from the Rhino model> x4])
attractor_points = Point([<point referenced from the Rhino model> x2])
ln = Line(StartPoint=cylinder_points, EndPoint=graft(attractor_points))
dots = DotDisplay(Point=attractor_points, Colour=RGB(0, 0, 0), Size=Slider(0.3, range=0..1))
len = Length(Curve=ln)  # -> simplify(Length)
sort = SortList(Keys=flatten(len))  # -> reverse(Keys), ValuesA
item = ListItem(List=sort.Keys, Index=0, Wrap=True)
viewer = ParamViewer(len)
division = Division(A=len, B=item)
multiplication = Multiplication(A=division, B=Slider(20, range=0..100))
panel = Panel(multiplication)
flip = FlipMatrix(Data=panel)
item_2 = ListItem(List=flip, Index=0, Wrap=True)
panel_2 = Panel(flip)
flatten = FlattenTree(Tree=item_2, Path="{0}")
panel_3 = Panel(cylinder_points)
cyl = Cylinder(Base=cylinder_points, Radius=0.5, Length=flatten)
panel_4 = Panel(flatten)
panel_5 = Panel(cyl)

panel_6 = Panel("""A
B
C
D
E
G""")
graft = GraftTree(Tree=panel_6, IncludeEmptyLists=True, IncludeNullItems=True)
panel_7 = Panel(graft)
flatten_2 = FlattenTree(Tree=panel_7, Path="{0}")
panel_8 = Panel(flatten_2)

panel_9 = Panel("""D
E
G""")
panel_10 = Panel("""A
B
C""")
entwine = Entwine(Branch00=panel_10, Branch01=panel_9, FlattenInputs=True)
panel_11 = Panel(entwine)
clean = CleanTree(RemoveNulls=True, RemoveInvalid=True, RemoveEmpty=Toggle(True), Tree=panel_11)
cleaning_empty_branches = Panel(clean)
clean_2 = CleanTree(RemoveNulls=True, RemoveInvalid=True, RemoveEmpty=False, Tree=panel_11)
default_cleaning_of_the_tree = Panel(clean_2)

pt = ConstructPoint(XCoordinate=0, YCoordinate=0, ZCoordinate=0)
Y = UnitY(Factor=1)
X = UnitX(Factor=Slider(4, range=0..10))
line = LineSDL(Start=pt, Direction=Y, Length=Slider(51, range=0..100))
panel_12 = Panel("""true
false""")
number_slider = Slider(13, range=0..100)
arrlinear = LinearArray(Geometry=line, Direction=X, Count=Slider(12, range=0..100))  # -> Geometry, Transform
dispatch = Dispatch(List=arrlinear.Geometry, DispatchPattern=panel_12)  # -> ListA, ListB
panel_13 = Panel("""1
1
0
0""")
divide = DivideCurve(Curve=dispatch.ListA, Count=number_slider, Kinks=False)  # -> Points, Tangents, Parameters
divide_2 = DivideCurve(Curve=dispatch.ListB, Count=number_slider, Kinks=False)  # -> Points, Tangents, Parameters
cull = CullPattern(List=divide_2.Points, CullPattern=invert(panel_13))
cull_2 = CullPattern(List=divide.Points, CullPattern=panel_13)
weave = Weave(Pattern=reverse(panel_13), Stream0=cull_2, Stream1=cull, NullGaps=False)
colour = ColourPicker(PickedColour=RGB(181, 85, 85))
nurbs = NurbsCurve(Vertices=weave, Degree=3, Periodic=False)  # -> Curve, Length, Domain
revsrf = Revolution(Curve=flatten(nurbs.Curve), Axis=dispatch.ListA, Domain=Domain(0, 6.283185307))
revsrf_2 = Revolution(Curve=flatten(nurbs.Curve), Axis=dispatch.ListB, Domain=Domain(0, 6.283185307))
preview = CustomPreview(
    Geometry=revsrf,
    Material={diffuse=RGB(221, 160, 221), emission=RGB(66, 48, 66), shine=0.5, specular=RGB(255, 255, 255), transparency=0})
preview_2 = CustomPreview(Geometry=revsrf_2, Material=colour)

panel_14 = Panel("""C
C
C""")

panel_15 = Panel("""B
B
B""")
panel_16 = Panel("""A
A
A""")
panel_17 = Panel("""0
2
1
0""")
weave_2 = Weave(Pattern=panel_17, Stream0=panel_16, Stream1=panel_15, Stream2=panel_14, NullGaps=False)
panel_18 = Panel(weave_2)

panel_19 = Panel("""ABC
DEF""")
panel_20 = Panel("""123
456""")
panel_21 = Panel("""@#$
^@&""")
entwine_2 = Entwine(Branch00=panel_19, Branch01=panel_20, FlattenInputs=True)
entwine_3 = Entwine(
    Branch0X=entwine_2,
    Branch1X=panel_21,
    Branch2X=Slider(6, range=0..10),
    Branch3X=Slider(6, range=0..10),
    FlattenInputs=False)
viewer_2 = ParamViewer(entwine_3)
flatten_3 = FlattenTree(Tree=entwine_3, Path="{0}")
trim = TrimTree(Tree=entwine_3, Depth=Slider(1, range=1..5))
panel_22 = Panel(entwine_3)
viewer_3 = ParamViewer(trim)
panel_23 = Panel(trim)
panel_24 = Panel(flatten_3)

data = Data(entwine_3)
panel_25 = Panel(data)
tstat = TreeStatistics(Tree=data)  # -> Paths, Length, Count
panel_26 = Panel(tstat.Count)
panel_27 = Panel(tstat.Length)
panel_28 = Panel(tstat.Paths)

# ----
# MultiPoint attractor
crv = Curve(<curve referenced from the Rhino model>)
pt_2 = Point([<point referenced from the Rhino model> x3])
boundary = BoundarySurfaces(Edges=crv)
graft_2 = GraftTree(Tree=pt_2, IncludeEmptyLists=True, IncludeNullItems=True)
popgeo = PopulateGeometry(Geometry=boundary, Count=Slider(756, range=0..1000), Seed=1)
pt_3 = Point(graft_2)
dist = Distance(PointA=popgeo, PointB=pt_3)
sort_2 = SortList(Keys=flatten(dist))  # -> Keys, ValuesA
ln_2 = Line(StartPoint=popgeo, EndPoint=pt_3)
item_3 = ListItem(List=reverse(sort_2.Keys), Index=0, Wrap=True)
division_2 = Division(A=dist, B=item_3)
multiplication_2 = Multiplication(A=division_2, B=Slider(2, range=0..10))
flip_2 = FlipMatrix(Data=multiplication_2)
sort_3 = SortList(Keys=flip_2)  # -> Keys, ValuesA
item_4 = ListItem(List=sort_3.Keys, Index=0, Wrap=True)  # -> flatten(Item)
circle = CircleCNR(Center=popgeo, Normal=Vector(0, 0, 1), Radius=item_4)

filter = StreamFilter(Gate=Slider(0, range=0..4), Stream0="A", Stream1="B", Stream2="C", Stream3="D")
panel_29 = Panel(filter)

series = Series(Start=0, Step=1, Count=10)

relay = Relay()
panel_30 = Panel("3")

relay_2 = Relay()
panel_31 = Panel("1")

relay_3 = Relay()
panel_32 = Panel("0")

relay_4 = Relay()
panel_33 = Panel("2")

panel_34 = Panel("""ABC
DEF""")
panel_35 = Panel("""123
456""")
panel_36 = Panel("""@#$
^@&""")
entwine_4 = Entwine(Branch00=panel_34, Branch01=panel_35, FlattenInputs=True)
entwine_5 = Entwine(
    Branch0X=entwine_4,
    Branch1X=panel_36,
    Branch2X=Slider(6, range=0..10),
    Branch3X=Slider(6, range=0..10),
    FlattenInputs=False)
viewer_4 = ParamViewer(panel_34)
viewer_5 = ParamViewer(entwine_4)
viewer_6 = ParamViewer(entwine_5)
panel_37 = Panel(entwine_5)

panel_38 = Panel(weave_2)
panel_39 = Panel(series)
split = SplitList(List=panel_38, Index=Slider(3, range=0..10))  # -> ListA, ListB
panel_40 = Panel(split.ListA)
panel_41 = Panel(split.ListB)

panel_42 = Panel("0;2")
panel_43 = Panel("3;0")
panel_44 = Panel("0;1")
panel_45 = Panel("0;0")
panel_46 = Panel("0;0;0")
panel_47 = Panel("0;0;1")
panel_48 = Panel("0;0;1;0")

len_2 = Length(Curve=ln)
viewer_7 = ParamViewer(len_2)
panel_49 = Panel(len_2)

entwine_6 = Entwine(Branch0X="a", Branch1X="b", Branch2X="c", FlattenInputs=False)
entwine_7 = Entwine(Branch0X=entwine_6, Branch1X="d", Branch2X="e", FlattenInputs=False)
entwine_8 = Entwine(Branch0X=entwine_7, Branch1X="f", Branch2X="g", FlattenInputs=False)
panel_50 = Panel(entwine_8)

viewer_8 = ParamViewer(entwine_8)
