# Grasshopper definition rotation.gh (Grasshopper 1.0.7)

# ---- group: good example
number_slider = Slider(18, range=0..100)
pt = ConstructPoint(XCoordinate=0, YCoordinate=0, ZCoordinate=0)
subtraction = Subtraction(A=number_slider, B=1)
box = CenterBox(Base=pt, X=Slider(10, range=0..100), Y=Slider(15, range=0..100), Z=Slider(0, range=0..100))
series = Series(Start=0, Step=Slider(4, range=0..10), Count=number_slider)
range = Range(Domain=Domain(0, 1), Steps=subtraction)
graph = GraphMapper(range, x0=0, x1=1, y0=0, y1=1, container_name="Bezier", cpx=[0, 0.4752608538, 0.605101645, 1], cpy=[0, 0, 1, 1])
Z = UnitZ(Factor=series)
move = Move(Geometry=box, Motion=Z)  # -> Geometry, Transform
multiplication = Multiplication(A=graph, B=Slider(100, range=0..100))
rotate = Rotate(Geometry=move.Geometry, Angle=degrees(multiplication), Plane=PlaneXY(0, 0, 0))  # -> Geometry, Transform

# ---- group: bad example
number_slider_2 = Slider(3, range=0..10)
pt_2 = ConstructPoint(XCoordinate=0, YCoordinate=0, ZCoordinate=0)
box_2 = CenterBox(Base=pt_2, X=Slider(10, range=0..100), Y=Slider(15, range=0..100), Z=Slider(0, range=0..100))
Z_2 = UnitZ(Factor=number_slider_2)
multiplication_2 = Multiplication(A=number_slider_2, B=100)
move_2 = Move(Geometry=box_2, Motion=Z_2)  # -> Geometry, Transform
rotate_2 = Rotate(Geometry=move_2.Geometry, Angle=degrees(multiplication_2), Plane=PlaneXY(0, 0, 0))  # -> Geometry, Transform
geo = Geometry(rotate_2.Geometry)

number_slider_3 = Slider(2, range=0..10)
pt_3 = ConstructPoint(XCoordinate=0, YCoordinate=0, ZCoordinate=0)
box_3 = CenterBox(Base=pt_3, X=Slider(10, range=0..100), Y=Slider(15, range=0..100), Z=Slider(0, range=0..100))
Z_3 = UnitZ(Factor=number_slider_3)
multiplication_3 = Multiplication(A=number_slider_3, B=100)
move_3 = Move(Geometry=box_3, Motion=Z_3)  # -> Geometry, Transform
rotate_3 = Rotate(Geometry=move_3.Geometry, Angle=degrees(multiplication_3), Plane=PlaneXY(0, 0, 0))  # -> Geometry, Transform
geo_2 = Geometry(rotate_3.Geometry)

number_slider_4 = Slider(0, range=0..10)
pt_4 = ConstructPoint(XCoordinate=0, YCoordinate=0, ZCoordinate=0)
box_4 = CenterBox(Base=pt_4, X=Slider(10, range=0..100), Y=Slider(15, range=0..100), Z=Slider(0, range=0..100))
Z_4 = UnitZ(Factor=number_slider_4)
multiplication_4 = Multiplication(A=number_slider_4, B=100)
move_4 = Move(Geometry=box_4, Motion=Z_4)  # -> Geometry, Transform
rotate_4 = Rotate(Geometry=move_4.Geometry, Angle=degrees(multiplication_4), Plane=PlaneXY(0, 0, 0))  # -> Geometry, Transform
geo_3 = Geometry(rotate_4.Geometry)

number_slider_5 = Slider(1, range=0..10)
pt_5 = ConstructPoint(XCoordinate=0, YCoordinate=0, ZCoordinate=0)
box_5 = CenterBox(Base=pt_5, X=Slider(10, range=0..100), Y=Slider(15, range=0..100), Z=Slider(0, range=0..100))
Z_5 = UnitZ(Factor=number_slider_5)
multiplication_5 = Multiplication(A=number_slider_5, B=100)
move_5 = Move(Geometry=box_5, Motion=Z_5)  # -> Geometry, Transform
rotate_5 = Rotate(Geometry=move_5.Geometry, Angle=degrees(multiplication_5), Plane=PlaneXY(0, 0, 0))  # -> Geometry, Transform
geo_4 = Geometry(rotate_5.Geometry)
