# Grasshopper definition lecture_6.gh (Grasshopper 1.0.7)

# ----
# Geometry place changing with plane transformations
initial_geometry = Geometry([<brep referenced from the Rhino model> x4])
initial_point = Point(<point referenced from the Rhino model>)
xy = XYPlane(Origin=initial_point)

crv = Curve(<curve referenced from the Rhino model>)
# Populate components
pop2d = Populate2D(Region=crv, Count=Slider(136, range=0..1000), Seed=Slider(7, range=0..10))

crv_2 = Curve(<curve referenced from the Rhino model>)
boundary = BoundarySurfaces(Edges=crv_2)
popgeo = PopulateGeometry(Geometry=boundary, Count=Slider(78, range=0..1000), Seed=Slider(7, range=0..10))

another_point = Point(<point referenced from the Rhino model>)

srf = Surface(<surface referenced from the Rhino model>)
popgeo_2 = PopulateGeometry(Geometry=srf, Count=Slider(134, range=0..1000), Seed=Slider(7, range=0..10))

another_point_2 = Point(<point referenced from the Rhino model>)

# ----
# Populate surfaces with geo
srf_2 = Surface(<surface referenced from the Rhino model>)
popgeo_3 = PopulateGeometry(Geometry=srf_2, Count=Slider(134, range=0..1000), Seed=Slider(7, range=0..10))

initial_geometry_2 = Geometry([<brep referenced from the Rhino model> x4])
# Populate surfaces with geo & random scale
initial_point_2 = Point(<point referenced from the Rhino model>)
xy_2 = XYPlane(Origin=initial_point_2)

# ----
# Python 'while' loop example
number_slider = Slider(6, range=1..10)
python = GhPythonScript(x=number_slider, y=Slider(24, range=0..100))  # -> out, a
# ---------- python: Python ----------
__author__ = "Mann"
__version__ = "2019.11.28"

import rhinoscriptsyntax as rs

temp = 0
result = []
while(temp < y):
    temp+=x
    result.append(temp)
    
a = result
# ---------- end python ----------
panel = Panel(python.a)

number_slider_2 = Slider(134, range=0..1000)
srf_3 = Surface(<surface referenced from the Rhino model>)
popgeo_4 = PopulateGeometry(Geometry=srf_3, Count=number_slider_2, Seed=Slider(7, range=0..10))

initial_geometry_3 = Geometry([<brep referenced from the Rhino model> x4])
initial_point_3 = Point(<point referenced from the Rhino model>)
xy_3 = XYPlane(Origin=initial_point_3)

# ---- group: we group it because we should have one object for simplicity
group = Group(Objects=initial_geometry)

# ----
xy_4 = XYPlane(Origin=another_point)
yz = YZPlane(Origin=another_point_2)

# ---- group: we group it because we should have one object for simplicity
group_2 = Group(Objects=initial_geometry_2)

group_3 = Group(Objects=initial_geometry_3)

# ----
dom = ConstructDomain(DomainStart=Slider(0.5, range=0.1..1), DomainEnd=Slider(1, range=0..1))
orient = Orient(Geometry=group, Source=xy, Target=xy_4)  # -> Geometry, Transform
ln = Line(StartPoint=xy, EndPoint=xy_4)
xy_5 = XYPlane(Origin=popgeo_3)
orient_2 = Orient(Geometry=group, Source=xy, Target=yz)  # -> Geometry, Transform
ln_2 = Line(StartPoint=xy, EndPoint=yz)
xy_6 = XYPlane(Origin=popgeo_4)
orient_3 = Orient(Geometry=group_2, Source=xy_2, Target=xy_5)  # -> Geometry, Transform
random = Random(Range=dom, Number=number_slider_2, Seed=2)
orient_4 = Orient(Geometry=group_3, Source=xy_3, Target=xy_6)  # -> Geometry, Transform
scale = Scale(Geometry=orient_4.Geometry, Center=popgeo_4, Factor=random)  # -> Geometry, Transform
center_of_scaling = Point(initial_point)
# Geometry scaling
geo = Geometry(group)

# ---- group: preferred axis scaling
X = UnitX(Factor=Slider(45, range=0..100))
move = Move(Geometry=center_of_scaling, Motion=X)  # -> Geometry, Transform
move_2 = Move(Geometry=geo, Motion=X)  # -> Geometry, Transform
scale_nu = ScaleNU(Geometry=move_2.Geometry, Plane=move.Geometry, ScaleX=1, ScaleY=1, ScaleZ=Slider(2, range=0..10))  # -> Geometry, Transform

# ---- group: uniform scaling
X_2 = UnitX(Factor=Slider(30, range=0..100))
move_3 = Move(Geometry=center_of_scaling, Motion=X_2)  # -> Geometry, Transform
move_4 = Move(Geometry=geo, Motion=X_2)  # -> Geometry, Transform
scale_2 = Scale(Geometry=move_4.Geometry, Center=move_3.Geometry, Factor=Slider(2, range=0..10))  # -> Geometry, Transform

# ---- group: preferred axis scaling
X_3 = UnitX(Factor=Slider(60, range=0..100))
move_5 = Move(Geometry=center_of_scaling, Motion=X_3)  # -> Geometry, Transform
move_6 = Move(Geometry=geo, Motion=X_3)  # -> Geometry, Transform
scale_nu_2 = ScaleNU(Geometry=move_6.Geometry, Plane=move_5.Geometry, ScaleX=1, ScaleY=Slider(6, range=0..10), ScaleZ=Slider(2, range=0..10))  # -> Geometry, Transform
