# Grasshopper definition l 7.gh (Grasshopper 1.0.7)

number_slider = Slider(17, range=0..100)
number_slider_2 = Slider(17, range=0..100)
number_slider_3 = Slider(13, range=0..100)
python = GhPythonScript(x=number_slider_2, y=number_slider_3, z=number_slider)  # -> out, a, b, c
# ---------- python: Python ----------
__author__ = "Mann"
__version__ = "2019.12.05"

import rhinoscriptsyntax as rs


def Create_number(initial_num):
    new_number = initial_num + 30
    return new_number
    
a = Create_number(x)
b = Create_number(y)
c = Create_number(z)
# ---------- end python ----------
pt = ConstructPoint(XCoordinate=number_slider_2, YCoordinate=number_slider_3, ZCoordinate=number_slider)
pt_2 = ConstructPoint(XCoordinate=python.a, YCoordinate=python.b, ZCoordinate=python.c)
panel = Panel(python.c)
ln = Line(StartPoint=pt, EndPoint=pt_2)

number_slider_4 = Slider(17, range=0..100)
number_slider_5 = Slider(17, range=0..100)
number_slider_6 = Slider(13, range=0..100)
python_2 = GhPythonScript(x=number_slider_5, y=number_slider_6, z=number_slider_4, value=Slider(23, range=0..100))  # -> out, a, b, c
# ---------- python_2: Python ----------
__author__ = "Mann"
__version__ = "2019.12.05"

import rhinoscriptsyntax as rs


def Create_number(initial_num):
    new_number = initial_num + value
    return new_number
    
a = Create_number(x)
b = Create_number(y)
c = Create_number(z)
# ---------- end python_2 ----------
pt_3 = ConstructPoint(XCoordinate=number_slider_5, YCoordinate=number_slider_6, ZCoordinate=number_slider_4)
pt_4 = ConstructPoint(XCoordinate=python_2.a, YCoordinate=python_2.b, ZCoordinate=python_2.c)
ln_2 = Line(StartPoint=pt_3, EndPoint=pt_4)
pipe = Pipe(Curve=ln_2, Radius=1, Caps=0)

number_slider_7 = Slider(17, range=0..100)
number_slider_8 = Slider(17, range=0..100)
number_slider_9 = Slider(13, range=0..100)
panel_2 = Panel([number_slider_8, number_slider_9, number_slider_7])
pt_5 = ConstructPoint(XCoordinate=number_slider_8, YCoordinate=number_slider_9, ZCoordinate=number_slider_7)
python_3 = GhPythonScript(coords=panel_2, value=Slider(23, range=0..100))  # -> out, temp; inputs coords: list
# ---------- python_3: Python ----------
__author__ = "Mann"
__version__ = "2019.12.05"

import rhinoscriptsyntax as rs


def Create_number(initial_num):
    new_number = initial_num + value
    return new_number
    
a = Create_number(float(coords[0]))
b = Create_number(float(coords[1]))
c = Create_number(float(coords[2]))

result = []
result.append(a)
result.append(b)
result.append(c)

temp = result
# ---------- end python_3 ----------
item = ListItem(List=python_3.temp, Index=0, Wrap=True)  # -> Item, Item1, Item2
pt_6 = ConstructPoint(XCoordinate=item.Item, YCoordinate=item.Item1, ZCoordinate=item.Item2)
ln_3 = Line(StartPoint=pt_5, EndPoint=pt_6)
pipe_2 = Pipe(Curve=ln_3, Radius=1, Caps=0)

number_slider_10 = Slider(17, range=0..100)
# Compact writing
number_slider_11 = Slider(17, range=0..100)
number_slider_12 = Slider(13, range=0..100)
panel_3 = Panel([number_slider_11, number_slider_12, number_slider_10])
pt_7 = ConstructPoint(XCoordinate=number_slider_11, YCoordinate=number_slider_12, ZCoordinate=number_slider_10)
python_4 = GhPythonScript(coords=panel_3, value=Slider(19, range=0..100))  # -> out, temp; inputs coords: list
# ---------- python_4: Python ----------
__author__ = "Mann"
__version__ = "2019.12.05"

import rhinoscriptsyntax as rs


def Create_number(initial_num):
    return initial_num + value
    
result = []


for item in coords:
    result.append(Create_number(item))
    
temp = result
# ---------- end python_4 ----------
item_2 = ListItem(List=python_4.temp, Index=0, Wrap=True)  # -> Item, Item1, Item2
panel_4 = Panel(python_4.out)
pt_8 = ConstructPoint(XCoordinate=item_2.Item, YCoordinate=item_2.Item1, ZCoordinate=item_2.Item2)
ln_4 = Line(StartPoint=pt_7, EndPoint=pt_8)
pipe_3 = Pipe(Curve=ln_4, Radius=1, Caps=0)

number_slider_13 = Slider(17, range=0..100)
# For loop
number_slider_14 = Slider(17, range=0..100)
number_slider_15 = Slider(13, range=0..100)
panel_5 = Panel([number_slider_14, number_slider_15, number_slider_13])
pt_9 = ConstructPoint(XCoordinate=number_slider_14, YCoordinate=number_slider_15, ZCoordinate=number_slider_13)
python_5 = GhPythonScript(coords=panel_5, value=Slider(19, range=0..100))  # -> out, temp; inputs coords: list
# ---------- python_5: Python ----------
__author__ = "Mann"
__version__ = "2019.12.05"

import rhinoscriptsyntax as rs


def Create_number(initial_num):
    new_number = initial_num + value
    return new_number
    
result = []
total_items = len(coords)
# print(total_items)

for item in range(total_items):
    print("cycle",item)
    new_result = Create_number(coords[item])
    result.append(new_result)
    
temp = result
# ---------- end python_5 ----------
item_3 = ListItem(List=python_5.temp, Index=0, Wrap=True)  # -> Item, Item1, Item2
panel_6 = Panel(python_5.out)
pt_10 = ConstructPoint(XCoordinate=item_3.Item, YCoordinate=item_3.Item1, ZCoordinate=item_3.Item2)
ln_5 = Line(StartPoint=pt_9, EndPoint=pt_10)
pipe_4 = Pipe(Curve=ln_5, Radius=1, Caps=0)

buildings = Geometry([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])

# ----
# Variables
panel_7 = Panel("test")
# Functions
sph = Sphere(Base=PlaneXY(0, 0, 0), Radius=1)
python_6 = GhPythonScript(x=panel_7)  # -> out, output
# ---------- python_6: Python ----------
__author__ = "Mann"
__version__ = "2019.12.05"

import rhinoscriptsyntax as rs

output = x
# ---------- end python_6 ----------
python_7 = GhPythonScript(x=sph)  # -> out, output; same code as python_6
data = Data(python_7.output)
panel_8 = Panel(python_6.output)

number_slider_16 = Slider(17, range=0..100)
number_slider_17 = Slider(17, range=0..100)
number_slider_18 = Slider(13, range=0..100)
number_slider_19 = Slider(15, range=0..100)
python_8 = GhPythonScript(temp=number_slider_17, value=number_slider_19)  # -> out, a
# ---------- python_8: Python ----------
__author__ = "Mann"
__version__ = "2019.12.05"

import rhinoscriptsyntax as rs


def Create_number(initial_num):
    new_number = initial_num + value
    return new_number
    
a = Create_number(temp)
# ---------- end python_8 ----------
python_9 = GhPythonScript(temp=number_slider_18, value=number_slider_19)  # -> out, a; same code as python_8
python_10 = GhPythonScript(temp=number_slider_16, value=number_slider_19)  # -> out, a; same code as python_8
pt_11 = ConstructPoint(XCoordinate=number_slider_17, YCoordinate=number_slider_18, ZCoordinate=number_slider_16)
pt_12 = ConstructPoint(XCoordinate=python_8.a, YCoordinate=python_9.a, ZCoordinate=python_10.a)
ln_6 = Line(StartPoint=pt_11, EndPoint=pt_12)
# Tree Access
# List Access
# Item Access
pipe_5 = Pipe(Curve=ln_6, Radius=1, Caps=0)

contour = Contour(Shape=buildings, Point=Point(0, 0, 0), Direction=Vector(0, 0, 1), Distance=10)
old_city = BooleanToggle(True)
trim = TrimTree(Tree=contour, Depth=1)
volume = Volume(Geometry=buildings)  # -> Volume, Centroid
item_4 = ListItem(List=trim, Index=0, Wrap=True)
python_11 = GhPythonScript(
    toggle=old_city,
    test_subject=Slider(46, range=0..100),
    old_town=Slider(10, range=0..10),
    downtown=Slider(250, range=0..1000))  # -> out, a
# ---------- python_11: Python ----------
__author__ = "Mann"
__version__ = "2019.12.05"

import rhinoscriptsyntax as rs

result = 0
if(toggle == True):
    if(test_subject <= old_town):
        result = True
    else:
        result = False
else:
    if(test_subject <= downtown):
        result = True
    else:
        result = False
        
a = result
# ---------- end python_11 ----------
area = Area(Geometry=item_4)  # -> flatten(Area), Centroid
len = Length(Curve=item_4)  # -> flatten(Length)
panel_9 = Panel(python_11.a)
python_12 = GhPythonScript(
    volumes=volume.Volume,
    maximum_height=Slider(1, range=1..250),
    per_person=Slider(5, range=5..30),
    site_c_length=len,
    area=area.Area)  # -> out, a
# ---------- python_12: Python ----------
__author__ = "Mann"
__version__ = "2019.12.05"

import rhinoscriptsyntax as rs


# functions
# for loop
# if statements
# ---------- end python_12 ----------
