# Grasshopper definition l 8.gh (Grasshopper 1.0.7)

# While loop
python = GhPythonScript()  # -> out, a
# ---------- python: Python ----------
__author__ = "Mann"
__version__ = "2019.12.12"

import rhinoscriptsyntax as rs


i = 0
while (-5 < i < 10):
    i += 1
    #print(i)
    


buildings = [10,15,10,50]
#index      [0 , 1, 2, 3]
i = 0
while(i < len(buildings)):
    #print("height",buildings[i])
    i+=2

stop = False
index = 0
while(stop == False):
    height = buildings[index]
    if(height > 10):
        stop = True
        print(buildings[index])
    index += 1
# ---------- end python ----------
panel = Panel(python.out)
